# Grasshopper definition UIparam_BeamView.gh (Grasshopper 1.0.7)
# plug-ins: karambaGH

number_slider = Slider(0.6, range=0..1)
unit_x = UnitX(Factor=1)
line_sdl = LineSDL(Start="0,0,0", Direction=unit_x, Length=Slider(10, range=0..10))
evaluate_curve = EvaluateCurve(Curve=line_sdl, Parameter=number_slider)  # -> Point, Tangent, Angle
material_selection_karamba3d = MaterialSelectionKaramba3D(menu=[dropdown(1), dropdown(1)])
end_points = EndPoints(Curve=line_sdl)  # -> Start, End
shatter = Shatter(Curve=line_sdl, Parameters=number_slider)

# ---- group: LoadCase - PointLoad - '0'
force = Panel("{0,0,-3}")
moment = Panel("{0,0,8}")  # disabled
loads_karamba3d = LoadsKaramba3D(ForceVector=force, MomentVector=moment, Local=False, PosInd=evaluate_curve.Point, LCase="0", mode="Point")
loads_karamba3d_2 = LoadsKaramba3D(Vector=Vector(0, 0, -1), LCase="0", mode="Gravity")

# ----
rotate_plane = RotatePlane(Plane=[end_points.Start, end_points.End], Angle=Slider(0, range=0..2))

# ---- group: LoadCase - 'all'
loads_karamba3d_3 = LoadsKaramba3D(ForceVector="{0,0,-3}", Local=False, PosInd=evaluate_curve.Point, LCase="all", mode="Point")
loads_karamba3d_4 = LoadsKaramba3D(Vector="{0,0,-1}", LCase="all", mode="Uniform Line", menu=[buttons(on, off, off)])
loads_karamba3d_5 = LoadsKaramba3D(Vector="{0,0,-1}", LCase="all", mode="Gravity")

# ---- group: LoadCase - Gravity - '1'
loads_karamba3d_6 = LoadsKaramba3D(Vector="{0,0,-5}", LCase="1", mode="Gravity")

# ---- group: LoadCase - LineLoad - 'test'
loads_karamba3d_7 = LoadsKaramba3D(Vector="{0,0,-1}", LCase="test", mode="Uniform Line", menu=[buttons(on, off, off)])
loads_karamba3d_8 = LoadsKaramba3D(Vector="{0,1,-3}", LCase="test", mode="Gravity")

# ----
cross_section_range_selector_karamba3d = CrossSectionRangeSelectorKaramba3D(
    MaximumHeight_cm=-1,
    MaximumWidth_cm=-1,
    Material=material_selection_karamba3d,
    menu=[dropdown(1), dropdown(1), dropdown(3)])
support_karamba3d = SupportKaramba3D(PosInd=[end_points.Start, end_points.End], PlaneOfReference=rotate_plane, menu=[buttons(on, on, on, on, off, on)])
line_to_beam_karamba3d = LineToBeamKaramba3D(Line=shatter, Identifier="beam", New=True, Remove=True, LimitDistance_m=0.005)  # -> Element, Points, Info
list_item = ListItem(List=cross_section_range_selector_karamba3d, Index="6", Wrap=True)
load_karamba3d = LoadKaramba3D([loads_karamba3d_2, loads_karamba3d, loads_karamba3d_7, loads_karamba3d_8, loads_karamba3d_6, loads_karamba3d_3, loads_karamba3d_4, loads_karamba3d_5])
assemble_model_karamba3d = AssembleModelKaramba3D(
    Elem=flatten(line_to_beam_karamba3d.Element),
    Support=flatten(support_karamba3d),
    Load=flatten(load_karamba3d),
    CrossSection=flatten(list_item),
    LimitDistance_m=0.005)  # -> Model, Info, Mass_kg, CenterOfGravity, LoadCaseNames
analyzethii_karamba3d = AnalyzeThIIKaramba3D(Model=assemble_model_karamba3d.Model, LoadCase="-1", RTolerance=1e-07, MaxIterations=50, NoTensionalNII=False)  # -> CalculatedModel, MaximumDisplacement_cm, ResultingForceOfGravity_kN, ElasticEnergy_kNm
upper_result_threshold = Slider(100, range=0..200)
lower_result_threshold = Slider(0, range=0..200)
deformation_scale = Slider(100, range=0..100)
result_threshold_as = ValueList({"% of Range": 0, "absolute value": 1}, selected="% of Range")
length_segment = Slider(1, range=0..2)
# ::: ModelView_pUI :::
# 
# Same functionality as the original ModelView-component, but with input plugs.
# If no inputs are connected - default ModelView-component values are used.
# 
# Drop-Down Menu with LoadCases is removed.
# LoadCase selection is done via the 'Result-Factors' input.
# -1 corresponds to --all--
# 
# Karamba3D sorts LoadCases:
# 0-1-2-...-a-b-c-...-z
# and sets index numbers accordingly.
cross_section_color = ValueList({"None": 0, "Elements": 1, "Cross Sections": 2, "Materials": 3}, selected="None")
local_axes_scale = Slider(1, range=0..2)
joints_scale = Slider(1, range=0..2)
reactions_scale = Slider(1, range=0..2)
supports_scale = Slider(0.2, range=0..2)
result_case = Slider(0, range=-1..3)
loads_scale = Slider(0.2, range=0..2)
material_names = BooleanToggle(False)
crosec_names = BooleanToggle(False)
element_tags = BooleanToggle(False)
eccentricities = BooleanToggle(False)
deformation = BooleanToggle(True)
element_ids = BooleanToggle(False)
load_values = BooleanToggle(False)
node_tags = BooleanToggle(False)
local_axes = BooleanToggle(False)
reactions = BooleanToggle(False)
supports = BooleanToggle(True)
elements = BooleanToggle(False)
loads = BooleanToggle(False)
joints = BooleanToggle(False)
nii = BooleanToggle(False)
model_view_karamba3d_pui = ModelViewKaramba3D_pUI(
    Model=analyzethii_karamba3d.CalculatedModel,
    ResultFactors=1,
    ResultCase=result_case,
    Deformation=deformation,
    DeformationScale=deformation_scale,
    Reaction=reactions,
    ReactionScale=reactions_scale,
    Loads=loads,
    LoadsScale=loads_scale,
    Supports=supports,
    SupportsScale=supports_scale,
    LocalAxes=local_axes,
    LocalAxesScale=local_axes_scale,
    Joints=joints,
    JointsScale=joints_scale,
    LengthSegment_m=length_segment,
    UpperResultThreshold=upper_result_threshold,
    LowerResultThreshold=lower_result_threshold,
    ResultThresholdAs=result_threshold_as,
    NodeTags=node_tags,
    ElementTags=element_tags,
    ElementIDs=element_ids,
    CroSecNames=crosec_names,
    MaterialNames=material_names,
    Eccentricities=eccentricities,
    LoadValues=load_values,
    Elements=elements,
    NII=nii,
    CrossSectionColor=cross_section_color)  # -> Model, DeformedMesh, DeformedAxes, DeformedModel
number_slider_2 = Slider(1, range=0.01..1)  # disabled
# ::: RenderedView :::
# 
# Scaling and de-/activation of symbols is handled with the ModelView-component, if no values are supported at the input plugs.
# 
# One LoadCase must be selected. --all-- is not an option.
# 
# The default scaling of the symbols is '1'.
# 
# If Input 'Breps' == false - symbols will be drawn as curves.
# 
# :Loads:
# {0} Gravity
# {1} PointLoads
# {2} Moment at PointLoad
# {3} LineLoads
# 
# :Supports:
# Right now, if Tx == false - no symbol will be drawn.
# 
# :Reactions:
# {0} Force
# {1} Moment
# 
# :Joints:
# Right now, not working proberly.
number_slider_3 = Slider(1, range=0.01..1)  # disabled
reactions_2 = BooleanToggle(False)  # disabled
supports_2 = BooleanToggle(True)  # disabled
loads_2 = BooleanToggle(True)
joints_2 = BooleanToggle(False)  # disabled
breps = BooleanToggle(True)
renderedview_karamba3d_pui = RenderedViewKaramba3D_pUI(
    Model=model_view_karamba3d_pui.Model,
    Breps=breps,
    Loads=loads_2,
    LoadsScale=Slider(1, range=0.01..1),
    Supports=supports_2,
    SupportsScale=Slider(1, range=0.01..1),
    Reactions=reactions_2,
    ReactionsScale=number_slider_2,
    Joints=joints_2,
    JointsScale=number_slider_3)  # -> Model, Loads, Supports, Reactions, Joints

# ---- group: Loads
explode_tree = ExplodeTree(Data=renderedview_karamba3d_pui.Loads)  # -> Branch0, Branch1, Branch2
custom_preview = CustomPreview(Geometry=explode_tree.Branch0, Material=ColourSwatch(SwatchColor=RGB(255, 238, 0)))
custom_preview_2 = CustomPreview(Geometry=explode_tree.Branch1, Material=ColourSwatch(SwatchColor=RGB(255, 81, 0)))
custom_preview_3 = CustomPreview(Geometry=explode_tree.Branch2, Material=ColourSwatch(SwatchColor=RGB(255, 0, 0)))

# ---- group: Reactions
explode_tree_2 = ExplodeTree(Data=renderedview_karamba3d_pui.Reactions)  # -> Branch0, Branch1
custom_preview_4 = CustomPreview(Geometry=explode_tree_2.Branch0, Material=ColourSwatch(SwatchColor=RGB(0, 255, 200)))
custom_preview_5 = CustomPreview(Geometry=explode_tree_2.Branch1, Material=ColourSwatch(SwatchColor=RGB(255, 0, 208)))

# ---- group: Supports
custom_preview_6 = CustomPreview(Geometry=renderedview_karamba3d_pui.Supports, Material=ColourSwatch(SwatchColor=RGBA(53, 176, 0, 200)))

# ----
# ::: BeamView_pUI :::
# 
# Same functionality as the original BeamView-component, but with input plugs.
# 
# If no inputs are connected - default BeamView-component values are used.
faces_crosssec = Slider(2, range=0..10)
render_style = ValueList({"Cross Section": 0, "Axial Stresses": 1, "Utilization": 2, "Displacement": 3}, selected="Utilization")
numbers = BooleanToggle(False)
filled = BooleanToggle(False)
mx = BooleanToggle(False)
my = BooleanToggle(False)
mz = BooleanToggle(False)
nx = BooleanToggle(False)
vy = BooleanToggle(False)
vz = BooleanToggle(False)
beamview = BeamView(
    Model=renderedview_karamba3d_pui.Model,
    Filled=filled,
    Numbers=numbers,
    Scale_kN_to_m=Slider(1, range=0..1),
    Scale_kNm_to_m=Slider(1, range=0..1),
    Mx=mx,
    My=my,
    Mz=mz,
    Nx=nx,
    Vy=vy,
    Vz=vz,
    Rendersettings=render_style,
    FacesCrossSection=faces_crosssec)  # -> Model, MeshesOfRenderedBeams, DeformedBeamAxes, LegendColors, LegendTags
legend = Legend(Colour=beamview.LegendColors, Tags=beamview.LegendTags, LegendType=1)
mesh = Mesh(beamview.MeshesOfRenderedBeams)
curve = Curve(beamview.DeformedBeamAxes)
