# Grasshopper definition UIparam_ShellView.gh (Grasshopper 1.0.7)
# plug-ins: karambaGH

curve = Curve(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)
point = Point([Point(0, 0, 0), Point(10, 0, 0), Point(10, 10, 0), Point(0, 10, 0)])
boundary_surfaces = BoundarySurfaces(Edges=curve)
xy_plane = XYPlane(Origin=Point(0, 0, 0))
mesh_breps_karamba3d = MeshBrepsKaramba3D(
    Brep=boundary_surfaces,
    MeshResolution=1,
    EdgeRefinementFactor=0.67,
    PointReduction=False,
    SmoothingStepSize=0,
    SmoothingIterations=5)  # -> Mesh, Info
list_item = ListItem(List=point, Index=0, Wrap=True)  # -> Item, Item1, Item2, Item3
rotate_plane = RotatePlane(Plane=xy_plane, Angle=Slider(1, range=0..2))

# ---- group: Cross Section
cross_section_karamba3d = CrossSectionKaramba3D(FamilyNameOfCrossSection="DefaultCroSec", Material=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, Height_cm="20", mode="Shell - Const")

# ---- group: Loads
loads_karamba3d = LoadsKaramba3D(
    Vector="{0,0,-3}",
    Mesh=mesh_breps_karamba3d.Mesh,
    LCase="0",
    mode="MeshLoad -Const.",
    menu=[buttons(off, on, off), buttons(on, on)])
loads_karamba3d_2 = LoadsKaramba3D(Vector=Vector(0, 0, -1), LCase="0", mode="Gravity")

# ---- group: Material Selection
material_selection_karamba3d = MaterialSelectionKaramba3D(menu=[dropdown(3), dropdown(2)])

# ---- group: Set Supports
support_karamba3d = SupportKaramba3D(PosInd=list_item.Item, menu=[buttons(off, on, on, off, off, off)])
support_karamba3d_2 = SupportKaramba3D(PosInd=list_item.Item1, PlaneOfReference=rotate_plane, menu=[buttons(on, off, on, on, on, off)])
support_karamba3d_3 = SupportKaramba3D(PosInd=list_item.Item2, menu=[buttons(off, off, on, off, on, on)])
support_karamba3d_4 = SupportKaramba3D(PosInd=list_item.Item3, menu=[buttons(on, on, on, on, off, on)])

# ----
mesh_to_shell_karamba3d = MeshToShellKaramba3D(Mesh=mesh_breps_karamba3d.Mesh, LimitDistance_m=0.005)  # -> Element, Points, Info
support_karamba3d_5 = SupportKaramba3D([support_karamba3d, support_karamba3d_2, support_karamba3d_3, support_karamba3d_4])
load_karamba3d = LoadKaramba3D([loads_karamba3d_2, loads_karamba3d])
assemble_model_karamba3d = AssembleModelKaramba3D(
    Elem=flatten(mesh_to_shell_karamba3d.Element),
    Support=flatten(support_karamba3d_5),
    Load=flatten(load_karamba3d),
    CrossSection=flatten(cross_section_karamba3d),
    Material=flatten(material_selection_karamba3d),
    LimitDistance_m=0.005)  # -> Model, Info, Mass_kg, CenterOfGravity, LoadCaseNames
analyzethii_karamba3d = AnalyzeThIIKaramba3D(Model=assemble_model_karamba3d.Model, LoadCase="-1", RTolerance=1e-07, MaxIterations=50, NoTensionalNII=False)  # -> CalculatedModel, MaximumDisplacement_cm, ResultingForceOfGravity_kN, ElasticEnergy_kNm
# ::: ModelView_pUI :::
# 
# Same functionality as the original ModelView-component, but with input plugs.
# If no inputs are connected - default ModelView-component values are used.
# 
# Drop-Down Menu with LoadCases is removed.
# LoadCase selection is done via the 'Result-Factors' input.
# -1 corresponds to --all--
# 
# Karamba3D sorts LoadCases:
# 0-1-2-...-a-b-c-...-z
# and sets index numbers accordingly.
number_slider = Slider(1, range=0..100)
model_view_karamba3d_pui = ModelViewKaramba3D_pUI(
    Model=analyzethii_karamba3d.CalculatedModel,
    ResultFactors=1,
    ResultCase=-1,
    Deformation=True,
    DeformationScale=number_slider,
    Reaction=False,
    ReactionScale=1,
    Loads=True,
    LoadsScale=0.2,
    Supports=True,
    SupportsScale=0.2,
    LocalAxes=False,
    LocalAxesScale=1,
    Joints=True,
    JointsScale=1,
    LengthSegment_m=1,
    UpperResultThreshold=100,
    LowerResultThreshold=0,
    ResultThresholdAs=0,
    NodeTags=False,
    ElementTags=False,
    ElementIDs=False,
    CroSecNames=False,
    MaterialNames=False,
    Eccentricities=True,
    LoadValues=False,
    Elements=True,
    NII=False,
    CrossSectionColor=0)  # -> Model, DeformedMesh, DeformedAxes, DeformedModel
princ_stress_1_2_scale = Slider(1, range=0..5)
local_layer_axes_scale = Slider(1, range=0..5)
position_of_results = Slider(1, range=-1..1)
index_of_layer = Slider(0, range=0..10)
value_list = ValueList({"Cross Section": 0, "Thickness": 1, "Utilization": 2, "Displacement": 3, "Princ. Stress 1": 4, "Princ. Stress 2": 5, "Equivalent Stress": 6}, selected="Thickness")
# ::: ShellView_pUI :::
# 
# Same functionality as the original BeamView-component, but with input plugs.
# 
# If no inputs are connected - default BeamView-component values are used.
princ_stress_1_2 = BooleanToggle(False)
local_layer_axes = BooleanToggle(False)
shell_view_karamba3d_pui = ShellViewKaramba3D_pUI(
    Model=model_view_karamba3d_pui.Model,
    IndexOfLayer=index_of_layer,
    LocalLayerAxes=local_layer_axes,
    LocalLayerAxes_2=local_layer_axes_scale,
    RenderStyle=value_list,
    PositionOfResults=position_of_results,
    PrincStress12=princ_stress_1_2,
    PrincStress12_2=princ_stress_1_2_scale)  # -> Model, MeshesOfRenderedShells, LegendColors, LegendTags
reactions = BooleanToggle(False)
supports = BooleanToggle(True)
loads = BooleanToggle(True)
# ::: RenderedView :::
# 
# Scaling and de-/activation of symbols is handled with the ModelView-component, if no values are supported at the input plugs.
# 
# One LoadCase must be selected. --all-- is not an option.
# 
# The default scaling of the symbols is '1'.
# 
# If Input 'Breps' == false - symbols will be drawn as curves.
# 
# :Loads:
# {0} Gravity
# {1} PointLoads
# {2} Moment at PointLoad
# {3} LineLoads
# 
# :Supports:
# Right now, if Tx == false - no symbol will be drawn.
# 
# :Reactions:
# {0} Force
# {1} Moment
# 
# :Joints:
# Right now, not working proberly.
joints = BooleanToggle(False)
breps = BooleanToggle(True)
legend = Legend(Colour=shell_view_karamba3d_pui.LegendColors, Tags=shell_view_karamba3d_pui.LegendTags, LegendType=1)
renderedview_karamba3d_pui = RenderedViewKaramba3D_pUI(
    Model=shell_view_karamba3d_pui.Model,
    Breps=breps,
    Loads=loads,
    LoadsScale=Slider(1, range=0.1..2),
    Supports=supports,
    SupportsScale=Slider(1, range=0.1..2),
    Reactions=reactions,
    ReactionsScale=Slider(0.1, range=0.1..2),
    Joints=joints)  # -> Model, Loads, Supports, Reactions, Joints
explode_tree = ExplodeTree(Data=renderedview_karamba3d_pui.Loads)  # -> Branch0, Branch1
explode_tree_2 = ExplodeTree(Data=renderedview_karamba3d_pui.Reactions)  # -> Branch0, Branch1

# ---- group: Loads
custom_preview = CustomPreview(Geometry=explode_tree.Branch0, Material=ColourSwatch(SwatchColor=RGB(255, 238, 0)))
custom_preview_2 = CustomPreview(Geometry=explode_tree.Branch1, Material=ColourSwatch(SwatchColor=RGB(255, 81, 0)))

# ---- group: Supports
custom_preview_3 = CustomPreview(Geometry=renderedview_karamba3d_pui.Supports, Material=ColourSwatch(SwatchColor=RGBA(53, 176, 0, 200)))

# ---- group: Reactions
custom_preview_4 = CustomPreview(Geometry=explode_tree_2.Branch0, Material=ColourSwatch(SwatchColor=RGB(0, 255, 200)))
custom_preview_5 = CustomPreview(Geometry=explode_tree_2.Branch1, Material=ColourSwatch(SwatchColor=RGB(255, 0, 208)))
